# Dynamo graph Duplicate Selected View.dyn (Dynamo 2.3.0.5885)
# packages: Clockwork for Dynamo 2.x 2.3.0, spring nodes 204.1.0

boolean = BoolSelector(true)
ꟿ_collect_currentselection = Custom[ꟿ Collect.CurrentSelection](refresh=boolean)  # package spring nodes; Gets the currently selected elements. Connect a boolean switch to refresh the selection.
duplicate_names = StringInput("")  # graph input
number_of_duplicates = IntegerSlider(10, range=0..100 step 1)  # graph input
code_block = CodeBlock(a=number_of_duplicates) { 1..a; }
code_block_2 = CodeBlock(a=duplicate_names, b=code_block) { a+" "+b; }
watch = Watch(code_block_2)
duplicate = Custom[View.Duplicate](view=ꟿ_collect_currentselection, name=watch)  # package Clockwork for Dynamo 2.x; Duplicates a given view
selected_view = Watch(ꟿ_collect_currentselection)  # graph output
