# Dynamo graph IF Statements.dyn (Dynamo 2.3.0.5885)

code_block = CodeBlock { 0; 1; }
code_block_2 = CodeBlock(a=code_block.out0, b=code_block.out1) { a==b; }
code_block_3 = CodeBlock { "T"; "F"; }
if_ = If(test=code_block_2, true=code_block_3.out0, false=code_block_3.out1)
watch = Watch(if_)
code_block_4 = CodeBlock { 0; 1; "T"; "F"; }
formula = Formula("if(a==b,t,f)", a=code_block_4.out0, b=code_block_4.out1, t=code_block_4.out2, f=code_block_4.out3)
watch_2 = Watch(formula)
loopWhile = LoopWhile()  # unwired: init, continueWhile, loopBody
