# Dynamo graph CreateSheets.dyn (Dynamo 2.3.0.5885)
# packages: DynaTools 2018.1.15

# group: USER INPUT
sheet_name = StringInput("Unnamed")  # graph input
# note: for only selecting appropriate family types (sheets)
# set an integer slider to a large enough number and use a watch block to show filtered results from the "select family type" node.
# The user must then select the number correllating to their chosen title block to be used for the new sheets.
number_of_sheets = IntegerSlider(10, range=1..20 step 1)  # graph input
sheet_number_prefix = StringInput("A_")  # graph input
first_sheet_number = DoubleInput(100)  # graph input
select_titleblock = FamilyTypes()  # nothing selected; graph input

sheetName = CodeBlock(a=sheet_name) { a; }
number_of_sheets_2 = CodeBlock(a=number_of_sheets) { a; }
ofRepeatedItem = List.OfRepeatedItem(item=sheetName, amount=number_of_sheets_2)
sheetNumPrefix = CodeBlock(a=sheet_number_prefix) { a; }
ofRepeatedItem_2 = List.OfRepeatedItem(item=sheetNumPrefix, amount=number_of_sheets_2)
code_block = CodeBlock(a=number_of_sheets_2) { 1..a; }
code_block_2 = CodeBlock(b=code_block) { a=b-1; }
round = Math.Round(number=first_sheet_number)
firstSheetNumber = CodeBlock(a=round) { a:int; }
ofRepeatedItem_3 = List.OfRepeatedItem(item=firstSheetNumber, amount=number_of_sheets_2)
code_block_3 = CodeBlock(b=ofRepeatedItem_2, c=code_block_2, d=ofRepeatedItem_3) { a=b+(c+d); }
createSheets = ViewTools.Sheets.CreateSheets(sheetNames=ofRepeatedItem, sheetNumbers=code_block_3, titleBlock=select_titleblock)
watch = Watch(createSheets)
