# Dynamo graph Duplicate View.dyn (Dynamo 2.3.0.5885)
# packages: Clockwork for Dynamo 2.x 2.3.0, spring nodes 204.1.0

boolean = BoolSelector(true)
ꟿ_collect_currentselection = Custom[ꟿ Collect.CurrentSelection](refresh=boolean)  # package spring nodes; Gets the currently selected elements. Connect a boolean switch to refresh the selection.
integer_slider = IntegerSlider(2, range=0..100 step 1)
code_block = CodeBlock(a=integer_slider) { 1..a; }
code_block_2 = CodeBlock(a=code_block) { "A_5850_3D "+a; }
watch = Watch(code_block_2)
duplicate = Custom[View.Duplicate](view=ꟿ_collect_currentselection, name=watch)  # package Clockwork for Dynamo 2.x; Duplicates a given view
watch_2 = Watch(ꟿ_collect_currentselection)
views = Views("A_5850_3D")
watch_3 = Watch(views)

# group: use integer slider to select type of duplicate. 1. Duplicate 2. Duplicate with detailing 3. Duplicate as dependent
if_ = If()  # unwired: test, true, false
formula = Formula("if(x==0,a,b)")  # unwired: x, a, b
