# Dynamo graph TitleblockIndex.dyn (Dynamo 2.3.0.5885)
# packages: Clockwork for Dynamo 2.x 2.3.0

categories = Categories("OST_TitleBlocks")
all_elements_of_category = ElementsOfCategory(Category=categories)
name = FamilyType.Name(familyType=all_elements_of_category)
uniqueItems = List.UniqueItems(list=name)
indexOf = List.IndexOf(list=name, element=uniqueItems)
getItemAtIndex = List.GetItemAtIndex(list=all_elements_of_category, index=indexOf)

# group: SELECT TITLEBLOCK
list_of_titleblocks = Watch(getItemAtIndex)

watch = Watch()  # unwired: arg0
family_types = FamilyTypes()  # nothing selected
family_types_2 = FamilyTypes()  # nothing selected
boolean = BoolSelector(true)
current = Document.Current()
all_family_types_of_category = Custom[All Family Types Of Category](toggle=boolean, docOrRevitLinkInstance=current)  # package Clockwork for Dynamo 2.x; Gets all family types/symbols of a given category in the model.; unwired: category
