# Dynamo graph CreateSheets(Old).dyn "CreateSheets" (Dynamo 2.3.0.5885)
# packages: DynaTools 2018.1.15

# group: USER INPUT
sheet_name = StringInput("Name")  # graph input
number_of_sheets = IntegerSlider(10, range=1..20 step 1)  # graph input
sheet_number_prefix = StringInput("__")  # graph input
first_sheet_number = DoubleInput(120)  # graph input
titleblock = DoubleInput(2)  # graph input

sheetName = CodeBlock(a=sheet_name) { a; }
number_of_sheets_2 = CodeBlock(a=number_of_sheets) { a; }
ofRepeatedItem = List.OfRepeatedItem(item=sheetName, amount=number_of_sheets_2)
sheetNumPrefix = CodeBlock(a=sheet_number_prefix) { a; }
ofRepeatedItem_2 = List.OfRepeatedItem(item=sheetNumPrefix, amount=number_of_sheets_2)
code_block = CodeBlock(a=number_of_sheets_2) { 1..a; }
code_block_2 = CodeBlock(b=code_block) { a=b-1; }
round = Math.Round(number=first_sheet_number)
firstSheetNumber = CodeBlock(a=round) { a:int; }
ofRepeatedItem_3 = List.OfRepeatedItem(item=firstSheetNumber, amount=number_of_sheets_2)
code_block_3 = CodeBlock(b=ofRepeatedItem_2, c=code_block_2, d=ofRepeatedItem_3) { a=b+(c+d); }
categories = Categories("OST_TitleBlocks")
all_elements_of_category = ElementsOfCategory(Category=categories)
name = FamilyType.Name(familyType=all_elements_of_category)
uniqueItems = List.UniqueItems(list=name)
indexOf = List.IndexOf(list=name, element=uniqueItems)
getItemAtIndex = List.GetItemAtIndex(list=all_elements_of_category, index=indexOf)
round_2 = Math.Round(number=titleblock)

# group: SELECT TITLEBLOCK
list_of_titleblocks = Watch(getItemAtIndex)
select_titleblock_index_from = CodeBlock(a=round_2) { a; }  # "Select Titleblock index from list below"

getItemAtIndex_2 = List.GetItemAtIndex(list=list_of_titleblocks, index=select_titleblock_index_from)
string_from_object = FromObject(obj=getItemAtIndex_2)
byName = FamilyType.ByName(name=string_from_object)
createSheets = ViewTools.Sheets.CreateSheets(sheetNames=ofRepeatedItem, sheetNumbers=code_block_3, titleBlock=byName)
watch = Watch(createSheets)
